# Grasshopper definition 000_utility_components.gh (Grasshopper 1.0.7)

# ----
# scritping with geometry
# utility components
number_slider = Slider(12, range=0..100)
assorted_scripts = GhPythonScript(x=Slider(12, range=0..100), y=number_slider)  # -> out, A, sum, sqrt, mult
# ---------- assorted_scripts: Python ----------
import math

print("Hello message to the console!");
print(x);
print("First input value was " + str(x));

# Outputs
A = "Hello World!";
sum = x + y;
sqrt = math.sqrt(x);
mult = x * y;
# ---------- end assorted_scripts ----------
panel = Panel(assorted_scripts.out)
panel_2 = Panel([assorted_scripts.A, assorted_scripts.sum, assorted_scripts.sqrt, assorted_scripts.mult])

division = GhPythonScript(A=Slider(10, range=-10..10), B=Slider(3.41, range=-10..10))  # -> out, R
# ---------- division: Python ----------
__author__ = "Sculpture"
__version__ = "2021.11.14"

import rhinoscriptsyntax as rs

# algorithm
sum = A / B

# output
R = sum

R = A / B
# ---------- end division ----------
subtraction = GhPythonScript(A=Slider(10, range=-10..10), B=Slider(3.41, range=-10..10))  # -> out, R
# ---------- subtraction: Python ----------
__author__ = "Sculpture"
__version__ = "2021.11.14"

import rhinoscriptsyntax as rs

# algorithm
sum = A - B

# output
R = sum

R = A - B
# ---------- end subtraction ----------
multiplication = GhPythonScript(A=Slider(10, range=-10..10), B=Slider(3.41, range=-10..10))  # -> out, R
# ---------- multiplication: Python ----------
__author__ = "Sculpture"
__version__ = "2021.11.14"

import rhinoscriptsyntax as rs

# algorithm
sum = A * B

# output
R = sum

R = A * B
# ---------- end multiplication ----------
addition = GhPythonScript(A=Slider(10, range=-10..10), B=Slider(10, range=-10..10))  # -> out, R
# ---------- addition: Python ----------
__author__ = "Sculpture"
__version__ = "2021.11.14"

import rhinoscriptsyntax as rs

# algorithm
sum = A + B

# output
R = sum

R = A + B
# ---------- end addition ----------
panel_3 = Panel(division.out)
panel_4 = Panel(division.R)
panel_5 = Panel(subtraction.out)
panel_6 = Panel(subtraction.R)
panel_7 = Panel(multiplication.out)
panel_8 = Panel(multiplication.R)
panel_9 = Panel(addition.out)
panel_10 = Panel(addition.R)

# ----
# using the
# ghpython
# component
# fundamentals of scripting
ghpython_script = GhPythonScript()  # -> Out, A
ghpython_script_2 = GhPythonScript()  # -> Out, A
panel_11 = Panel(ghpython_script_2.Out)
panel_12 = Panel(ghpython_script_2.A)

sqrt = GhPythonScript(A=Slider(4.69, range=-10..10))  # -> out, R
# ---------- sqrt: Python ----------
__author__ = "Sculpture"
__version__ = "2021.11.14"

import rhinoscriptsyntax as rs
import math

# algorithm
result = math.fabs(A)

# output
R = result
# ---------- end sqrt ----------
power = GhPythonScript(A=Slider(10, range=-10..10), B=Slider(2, range=-10..10))  # -> out, R
# ---------- power: Python ----------
__author__ = "Sculpture"
__version__ = "2021.11.14"

import rhinoscriptsyntax as rs
import math

# algorithm
result = math.pow(A, B)

# output
R = result
# ---------- end power ----------
sqrt_2 = GhPythonScript(A=Slider(35, range=-10..100))  # -> out, R
# ---------- sqrt_2: Python ----------
__author__ = "Sculpture"
__version__ = "2021.11.14"

import rhinoscriptsyntax as rs
import math

# algorithm
result = math.sqrt(A)

# output
R = result
# ---------- end sqrt_2 ----------
panel_13 = Panel(sqrt.out)
panel_14 = Panel(sqrt.R)
panel_15 = Panel(power.out)
panel_16 = Panel(power.R)
panel_17 = Panel(sqrt_2.out)
panel_18 = Panel(sqrt_2.R)

panel_19 = Panel()
string_length = GhPythonScript(S=panel_19)  # -> out, L
# ---------- string_length: Python ----------
__author__ = "Sculpture"
__version__ = "2021.11.14"

import rhinoscriptsyntax as rs

# algorithm
length = len(S)

# outputs
L = length
# ---------- end string_length ----------
string_characters = GhPythonScript(S="Hello World!")  # -> out, chars
# ---------- string_characters: Python ----------
__author__ = "Sculpture"
__version__ = "2021.11.14"

import rhinoscriptsyntax as rs

# Algorithm
characters = []

for i in range(len(S)):
    characters.append(S[i])
    i =+ 1

# Output
chars = characters
# ---------- end string_characters ----------
string_concatenate = GhPythonScript(A="Hello ", B="World!")  # -> out, R
# ---------- string_concatenate: Python ----------
__author__ = "Sculpture"
__version__ = "2021.11.14"

import rhinoscriptsyntax as rs

# Algorithm
result = A + B

# Output
R = result
# ---------- end string_concatenate ----------
panel_20 = Panel(string_length.out)
panel_21 = Panel(string_length.L)
panel_22 = Panel(string_concatenate.out)
panel_23 = Panel(string_characters.chars)
panel_24 = Panel(string_concatenate.R)

dom = ConstructDomain(DomainStart=Slider(0, range=0..10), DomainEnd=Slider(10, range=0..10))
series = GhPythonScript(S=Slider(1.108, range=0..10), N=Slider(3.012, range=0..10), C=Slider(6, range=0..10))  # -> out, Sout; inputs C: Int32
# ---------- series: Python ----------
__author__ = "Sculpture"
__version__ = "2021.11.14"

import rhinoscriptsyntax as rs

# algorithm
vals = []

for i in range(C):
    v = S + i * N
    vals.append(v)
    i += 1

# outputs
Sout = vals;
# ---------- end series ----------
series_2 = Series(Start=0, Step=1, Count=10)
range = GhPythonScript(D=dom, N=Slider(5, range=0..10))  # -> out, R; inputs N: Int32
# ---------- range: Python ----------
__author__ = "Sculpture"
__version__ = "2021.11.14"

import rhinoscriptsyntax as rs

# algorithm
step = (D.T1 - D.T0) / N

vals = []

for i in range(N + 1):
    v = D.T0 + i * step
    vals.append(v)
    i += 1

# outputs
R = vals
# ---------- end range ----------
range_2 = Range(Domain=Domain(0, 1), Steps=10)
panel_25 = Panel(series.out)
panel_26 = Panel(series.Sout)
panel_27 = Panel(range.out)
panel_28 = Panel(range.R)
