# Grasshopper definition 001_fundamentals.gh (Grasshopper 1.0.7)

# ----
# scripting fundamentals
number_slider = Slider(6.07, range=0..10)
create_point = GhPythonScript(x=number_slider, y=Slider(4.75, range=0..10), z=Slider(3.85, range=0..10))  # -> out, Pt
# ---------- create_point: Python ----------
__author__ = "Sculpture"
__version__ = "2021.11.14"

import rhinoscriptsyntax as rs

# algorithm
p = rs.CreatePoint(x, y, z)

# output
Pt = p
# ---------- end create_point ----------
deconstruct_point = GhPythonScript(P=create_point.Pt)  # -> out, X, Y, Z; inputs P: Point3d
# ---------- deconstruct_point: Python ----------
__author__ = "Sculpture"
__version__ = "2021.11.14"

import rhinoscriptsyntax as rs

# algorithm


# outputs
X = P.X
Y = P.Y
Z = P.Z
# ---------- end deconstruct_point ----------
panel = Panel(create_point.Pt)
panel_2 = Panel([deconstruct_point.X, deconstruct_point.Y, deconstruct_point.Z])

construct_point = ConstructPoint(XCoordinate=0, YCoordinate=0, ZCoordinate=0)
pt = Point(create_point.Pt)
line = GhPythonScript(A=construct_point, B=pt)  # -> out, L; inputs A: Point3d, B: Point3d
# ---------- line: Python ----------
import rhinoscriptsyntax as rs

# algorithm
line = rs.AddLine(A, B)

# outputs
L = line
# ---------- end line ----------
point_on_curve = GhPythonScript(L=line.L, t=Slider(0.6, range=0..1))  # -> out, t; inputs L: Line
# ---------- point_on_curve: Python ----------
__author__ = "Sculpture"
__version__ = "2021.11.14"

import rhinoscriptsyntax as rs

# algorithm
point = L.PointAt(t)

# outputs
P = point
# ---------- end point_on_curve ----------
panel_3 = Panel(point_on_curve.t)
panel_4 = Panel(line.L)

x = Slider(6.07, range=0..10)
y = Slider(4.75, range=0..10)
z = Slider(3.85, range=0..10)
pt_2 = Point(construct_point)
pt_3 = Point(pt)
vector2pt = GhPythonScript(A=pt_2, B=pt_3)  # -> out, V; inputs A: Point3d, B: Point3d
# ---------- vector2pt: Python ----------
__author__ = "Sculpture"
__version__ = "2021.11.14"

import rhinoscriptsyntax as rs

# algorithm
vector = B - A  #rc operator overloads

# outputs
V = vector
# ---------- end vector2pt ----------
construct_point_2 = CSharpScript(x=Slider(6.07, range=0..10), y=Slider(4.75, range=0..10), z=Slider(2.37, range=0..10))  # -> out, Pt; inputs x: Double, y: Double, z: Double
# ---------- construct_point_2: C# ----------
    // algorithm
    Point3d p = new Point3d(x, y, z);


    // output
    Pt = p;
# ---------- end construct_point_2 ----------
construct_vector = CSharpScript(x=Slider(2, range=0..10), y=Slider(2, range=0..10), z=Slider(10, range=0..10))  # -> out, V; inputs x: Double, y: Double, z: Double
# ---------- construct_vector: C# ----------
    // algorithm
    Vector3d vector = new Vector3d(x, y, z);


    // output
    V = vector;
# ---------- end construct_vector ----------
construct_vector_2 = CSharpScript(x=Slider(8.01, range=0..10), y=Slider(4.75, range=0..10), z=Slider(6.96, range=0..10))  # -> out, V; inputs x: Double, y: Double, z: Double; same code as construct_vector
create_vector = GhPythonScript(x=x, y=y, z=z)  # -> out, V
# ---------- create_vector: Python ----------
__author__ = "Sculpture"
__version__ = "2021.11.14"

import rhinoscriptsyntax as rs

# algorithm
vector = rs.CreateVector(x, y, z)

# output
V = vector
# ---------- end create_vector ----------
panel_5 = Panel(vector2pt.V)
panel_6 = Panel(create_vector.V)
create_plane = GhPythonScript(O=construct_point_2.Pt, x=construct_vector.V, y=construct_vector_2.V)  # -> out, Pl; inputs O: Point3d, x: Vector3d, y: Vector3d
# ---------- create_plane: Python ----------
__author__ = "Sculpture"
__version__ = "2021.11.14"

import rhinoscriptsyntax as rs

# algorithm
plane = rs.CreatePlane(O, x, y);

# outputs
Pl = plane;
# ---------- end create_plane ----------
panel_7 = Panel(create_plane.Pl)
