# Grasshopper definition 002_vector_components.gh (Grasshopper 1.0.7)

# ----
# scritping with geometry
number_slider = Slider(6.07, range=0..10)
create_point = GhPythonScript(x=number_slider, y=Slider(4.75, range=0..10), z=Slider(3.85, range=0..10))  # -> out, Pt
# ---------- create_point: Python ----------
__author__ = "Sculpture"
__version__ = "2021.11.14"

import rhinoscriptsyntax as rs

# algorithm
p = rs.CreatePoint(x, y, z)

# output
Pt = p
# ---------- end create_point ----------
deconstruct_point = GhPythonScript(P=create_point.Pt)  # -> out, X, Y, Z; inputs P: Point3d
# ---------- deconstruct_point: Python ----------
__author__ = "Sculpture"
__version__ = "2021.11.14"

import rhinoscriptsyntax as rs

# algorithm


# outputs
X = P.X
Y = P.Y
Z = P.Z
# ---------- end deconstruct_point ----------
panel = Panel(create_point.Pt)
panel_2 = Panel([deconstruct_point.X, deconstruct_point.Y, deconstruct_point.Z])

construct_point = ConstructPoint(XCoordinate=0, YCoordinate=0, ZCoordinate=0)
pt = Point(create_point.Pt)
line = GhPythonScript(A=construct_point, B=pt)  # -> out, L; inputs A: Point3d, B: Point3d
# ---------- line: Python ----------
import rhinoscriptsyntax as rs

# algorithm
line = rs.AddLine(A, B)

# outputs
L = line
# ---------- end line ----------
point_on_curve = GhPythonScript(L=line.L, t=Slider(0.6, range=0..1))  # -> out, t, P; inputs L: Line
# ---------- point_on_curve: Python ----------
__author__ = "Sculpture"
__version__ = "2021.11.14"

import rhinoscriptsyntax as rs

# algorithm
point = L.PointAt(t)

# outputs
P = point
# ---------- end point_on_curve ----------
panel_3 = Panel([point_on_curve.t, point_on_curve.P])
panel_4 = Panel(line.L)

x = Slider(6.07, range=0..10)
y = Slider(4.75, range=0..10)
z = Slider(3.85, range=0..10)
pt_2 = Point(construct_point)
pt_3 = Point(pt)
vector2pt = GhPythonScript(A=pt_2, B=pt_3)  # -> out, V; inputs A: Point3d, B: Point3d
# ---------- vector2pt: Python ----------
__author__ = "Sculpture"
__version__ = "2021.11.14"

import rhinoscriptsyntax as rs

# algorithm
vector = B - A  #rc operator overloads

# outputs
V = vector
# ---------- end vector2pt ----------
construct_point_2 = CSharpScript(x=Slider(6.07, range=0..10), y=Slider(4.75, range=0..10), z=Slider(2.37, range=0..10))  # -> out, Pt; inputs x: Double, y: Double, z: Double
# ---------- construct_point_2: C# ----------
    // algorithm
    Point3d p = new Point3d(x, y, z);


    // output
    Pt = p;
# ---------- end construct_point_2 ----------
construct_vector = CSharpScript(x=Slider(2, range=0..10), y=Slider(2, range=0..10), z=Slider(10, range=0..10))  # -> out, V; inputs x: Double, y: Double, z: Double
# ---------- construct_vector: C# ----------
    // algorithm
    Vector3d vector = new Vector3d(x, y, z);


    // output
    V = vector;
# ---------- end construct_vector ----------
construct_vector_2 = CSharpScript(x=Slider(8.01, range=0..10), y=Slider(4.75, range=0..10), z=Slider(6.96, range=0..10))  # -> out, V; inputs x: Double, y: Double, z: Double; same code as construct_vector
create_vector = GhPythonScript(x=x, y=y, z=z)  # -> out, V
# ---------- create_vector: Python ----------
__author__ = "Sculpture"
__version__ = "2021.11.14"

import rhinoscriptsyntax as rs

# algorithm
vector = rs.CreateVector(x, y, z)

# output
V = vector
# ---------- end create_vector ----------
panel_5 = Panel(vector2pt.V)
panel_6 = Panel(create_vector.V)
create_plane = GhPythonScript(O=construct_point_2.Pt, x=construct_vector.V, y=construct_vector_2.V)  # -> out, Pl; inputs O: Point3d, x: Vector3d, y: Vector3d
# ---------- create_plane: Python ----------
import rhinoscriptsyntax as rs

# algorithm
plane = rs.CreatePlane(O, x, y);

# outputs
Pl = plane;
# ---------- end create_plane ----------
panel_7 = Panel(create_plane.Pl)

# ----
# scritping vector components
vec = Vector(create_vector.V)
vec_2 = Vector(create_vector.V)
vec_3 = Vector(create_vector.V)
vector_length = GhPythonScript(V=vec)  # -> out, L; inputs V: Vector3d
# ---------- vector_length: Python ----------
import math

# algorithm
#length = math.sqrt(V.X * V.X + V.Y * V.Y + V.Z * V.Z) #manual

# algorithm Rhino Common
length = V.Length

# outputs
L = length;
# ---------- end vector_length ----------
set_vector_length = GhPythonScript(V=vec_2, L=Slider(2.6, range=0..10))  # -> out, Vout; inputs V: Vector3d
# ---------- set_vector_length: Python ----------
__author__ = "Sculpture"
__version__ = "2021.11.15"

import rhinoscriptsyntax as rs
import math

# algorithm
#length = math.sqrt(V.X * V.X + V.Y * V.Y + V.Z * V.Z) #manual
#factor = L / length
#newV = rs.CreateVector(factor * V.X, factor * V.Y, factor * V.Z)
#print type(newV)

# algorithm Rhino Common
V.Unitize()
newV = L * V # operator overloading
print type(newV)

# outputs
Vout = newV
# ---------- end set_vector_length ----------
unitize_vector = GhPythonScript(V=vec_3)  # -> out, Vout; inputs V: Vector3d
# ---------- unitize_vector: Python ----------
import rhinoscriptsyntax as rs
import math

# algorithm
#length = math.sqrt(V.X * V.X + V.Y * V.Y + V.Z * V.Z) #manual
#newV = rs.CreateVector(V.X / length, V.Y / length, V.Z / length)

# algorithm Rhino Common
V.Unitize()

# outputs
#Vout = newV;
Vout = V;
# ---------- end unitize_vector ----------
panel_8 = Panel(set_vector_length.out)
panel_9 = Panel(unitize_vector.Vout)
panel_10 = Panel(set_vector_length.Vout)
panel_11 = Panel(unitize_vector.out)
panel_12 = Panel(vector_length.L)
panel_13 = Panel(vector_length.out)

number_slider_2 = Slider(0.57, range=0..1)
xz = XZPlane(Origin=Point(0, 0, 0))
vec_4 = Vector(create_vector.V)
vec_5 = Vector(construct_vector_2.V)
vec_6 = Vector(construct_vector.V)
vec_7 = Vector(create_vector.V)
vec_8 = Vector(construct_vector_2.V)
vector_addition = GhPythonScript(A=vec_7, B=vec_7)  # -> out, V; inputs A: Vector3d, B: Vector3d
# ---------- vector_addition: Python ----------
__author__ = "Sculpture"
__version__ = "2021.11.15"

import rhinoscriptsyntax as rs

# algorithm (manual)
#sum = rs.CreateVector(A.X + B.X, A.Y + B.Y, A.Z + B.Z)

# algorithm (RhinoCommon)
sum = A + B

# outputs
V = sum
# ---------- end vector_addition ----------
vector_tween = GhPythonScript(A=vec_4, B=vec_5, t=Slider(0.516, range=-5..5))  # -> out, V; inputs A: Vector3d, B: Vector3d
# ---------- vector_tween: Python ----------
__author__ = "Sculpture"
__version__ = "2021.11.15"

import rhinoscriptsyntax as rs

# algorithm (manual)
#dx = B.X - A.X
#dy = B.Y - A.Y
#dz = B.Z - A.Z
#tween = rs.CreateVector(
#A.X + t * dx,
#A.Y + t * dy,
#A.Z + t * dz)

# algorithm (RhinoCommon)
C = B - A;
tween = A + C * t

# outputs
V = tween
# ---------- end vector_tween ----------
vector_cross_product = GhPythonScript(A=vec_6, B=vec_8, U=Toggle(True))  # -> out, V, L; inputs A: Vector3d, B: Vector3d, U: Boolean
# ---------- vector_cross_product: Python ----------
__author__ = "Sculpture"
__version__ = "2021.11.15"

import rhinoscriptsyntax as rs

# Algorithm
cross = rs.VectorCrossProduct(A, B) #factory constructor pattern

if (U == True):
    cross.Unitize()

# Outputs
V = cross
L = cross.Length
# ---------- end vector_cross_product ----------
vdis = VectorDisplay(Anchor=xz, Vector=vector_tween.V)
vdis_2 = VectorDisplay(Anchor=xz, Vector=vec_4)
vdis_3 = VectorDisplay(Anchor=xz, Vector=vec_5)
panel_14 = Panel(vector_tween.out)
panel_15 = Panel(vector_tween.V)
panel_16 = Panel(vector_cross_product.L)
panel_17 = Panel(vector_addition.out)
panel_18 = Panel(vector_addition.V)
panel_19 = Panel(vector_cross_product.out)
panel_20 = Panel(vector_cross_product.V)
